% Simulink data dictionary CodeGenPlantData.sldd
% references RespiratorControlData.sldd

UserButtons = Simulink.Bus()  % Respirator user buttons bus
  Start: boolean  % Start button
  Stop: boolean  % Stop button
  Alarm: boolean  % Alarm snooze button
  Service: boolean  % Service button
  PPeakPlus: boolean  % PPeak target plus button
  PPeakMinus: boolean  % PPeak target minus button
  PStaticPlus: boolean  % PStatic target plus button
  PStaticMinus: boolean  % PStatic target minus button
  PeepPlus: boolean  % Peep target plus button
  PeepMinus: boolean  % Peep target minus button
  NCyclePlus: boolean  % Cycle per minute plus button
  NCycleMinus: boolean  % Cycle per minute minus button