% Simulink data dictionary RespiratorControlData.sldd

NPAirMeasuredRaw = Simulink.Signal(DataType="single", Min=0, Max=1)  % Air pressure sensor raw value as a ratio of 0V and full scale voltage range
NAlaramsActive = Simulink.Signal(DataType="uint16", Min=0, Dimensions=10)  % Active alarms array
rBlowerPwm = Simulink.Signal(DataType="single", Min=0, Max=1)  % Blower command output
NScreenData = Simulink.Signal(DataType="uint8", Min=0, Max=255, Dimensions=10)  % Active alarms array
NTelemetryTxFrame = Simulink.Signal(DataType="uint8", Min=0, Max=255, Dimensions=10)  % Active alarms array
nBlowerCmd = Simulink.Signal(DataType="single", Min=0, Max=100000, Unit="rpm")  % Blower speed target
BBuzzerCmdIn = Simulink.Signal(DataType="boolean")  % Alarm buzzer command
NCyclePerMin = Simulink.Signal(DataType="single", Min=0, Max=100, Unit="cycle/min")  % Number of respiration cycles per minute
rInhalationPerCycle = Simulink.Signal(DataType="single", Min=0, Max=1)  % Inhalation exhalation time ratio in a respiration cycle
VpBlowerValveOutletAnalog = Simulink.Signal(DataType="single", Min=0, Max=5000, Unit="mV")  % Air pressure sensor analogic value
BBuzzerCmdOut = Simulink.Signal(DataType="boolean", Min=0, Max=1)  % Buzzer command output
CodeGenMdlConfig = Simulink.ConfigSet(StartTime="0", StopTime="10", FixedStep="MdlTS", Solver="FixedStepDiscrete", ProdHWDeviceType="ARM Compatible->ARM Cortex", SystemTargetFile="ert.tlc", HardwareBoard="STM32 Nucleo F411RE", TargetLang="C")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
pBlowerValveOutletStaticTarget = Simulink.Signal(DataType="single", Min=0, Max=1500, Unit="mmH20")  % Inhalation plateau air pressure target
pPatientValveInletTarget = Simulink.Signal(DataType="single", Min=0, Max=1500, Unit="mmH20")  % Exhalation end air pressure target
pBlowerValveOutletFiltered = Simulink.Signal(DataType="single", Min=0, Max=1500, Unit="mmH20")  % Blower valve outlet pressure measured filtered
fBlowerPwmFrequency = Simulink.Parameter(1000, DataType="double", Min=0, Max=10000, Unit="Hz")  % Blower motor PWM frequency
rBlowerValveCmd = Simulink.Signal(DataType="single", Min=0, Max=100, Unit="%")  % Inhalation valve opening command
rPatientValveCmd = Simulink.Signal(DataType="single", Min=0, Max=100, Unit="%")  % Exhalation valve opening command
rBlowerValvePwm = Simulink.Signal(DataType="single", Min=0, Max=1)  % Inhale valve command output
rPatientValvePwm = Simulink.Signal(DataType="single", Min=0, Max=1)  % Exhale valve command output
nBlowerCmdApplied = Simulink.Signal(DataType="single", Min=0, Max=100000, Unit="rpm", InitialValue="0")  % Blower motor speed command applied
rBlowerValveCmdApplied = Simulink.Signal(DataType="single", Min=0, Max=100, Unit="%", InitialValue="0")  % Blower valve opening command applied
aValvePwm100 = -256.85722
rPwmZeroDeg = 50
fValvePwmFrequency = Simulink.Parameter(1000, DataType="double", Min=0, Max=10000, Unit="Hz")  % Blower motor PWM frequency
aValveFullOpen = -90
aValveFullClose = -255
pBlowerValveOutletCorr = Simulink.Signal(DataType="single", Min=0, Max=1500, Unit="mmH2O", InitialValue="0")  % pBlowerValveOutlet measure corrected by the offset
BStartBtnIn = Simulink.Signal(DataType="boolean", InitialValue="0")  % Start button physical input
BStopBtnIn = Simulink.Signal(DataType="boolean", InitialValue="0")  % Stop button physical input
BAlarmSnoozeBtnIn = Simulink.Signal(DataType="boolean", InitialValue="0")  % Snooze alarm button physical input
BServiceBtnIn = Simulink.Signal(DataType="boolean", InitialValue="0")  % Service button physical input
BStartBtnPressed = Simulink.Signal(DataType="boolean", InitialValue="0")  % Start button pressed flag
BStopBtnPressed = Simulink.Signal(DataType="boolean", InitialValue="0")  % Stop button pressed flag
BAlarmSnoozeBtnPressed = Simulink.Signal(DataType="boolean")  % Alarm snooze button pressed flag
BServiceBtnPressed = Simulink.Signal(DataType="boolean", InitialValue="0")  % Service button pressed flag
NTBlowerMotorRaw = Simulink.Signal(DataType="single", Min=0, Max=1, InitialValue="0")  % Blower motor temperature ADC value
NVBatteryRaw = Simulink.Signal(DataType="single", Min=0, Max=1, InitialValue="0")  % Battery voltage ADC value
VBatteryMeasured = Simulink.Signal(DataType="single", Min=0, Max=50, Unit="V", InitialValue="0")  % Battery voltage measured
VVBatteryAnalog = Simulink.Signal(DataType="single", Min=0, Max=3300, Unit="mV", InitialValue="0")  % Battery voltage measurement analog value
TBlowerMotorScaledValueMap = Simulink.Parameter([125 110 96 78.5 19.5 4 -4 -20], DataType="single", Min=-50, Max=300, Unit="°C")  % Blower motor temperature sensor scaled values vector
VTBlowerMotorScaledValueAxis = Simulink.Parameter([333 476 666 1000 2670 2966 3070 3200], DataType="single", Min=0, Max=5000, Unit="mV")  % Blower motor temperature sensor analog values vector
rBlowerValveCtrlCmd = Simulink.Signal(DataType="single", Min=0, Max=100, Unit="%", InitialValue="0")  % Blower valve opening target from control
rPatientValveCtrlCmd = Simulink.Signal(DataType="single", Min=0, Max=100, Unit="%", InitialValue="0")  % Patient valve opening target from control

eActuators = enum(DataScope="Exported", HeaderFile="ActuatorsToTest.h", DefaultValue="None")  % Outputs test mode actuators enumeration
  None = 0
  BlowerMotor = 1
  BlowerValve = 2
  PatientValve = 3

rActuatorTestMaxCmdRatio = Simulink.Signal(DataType="single", Min=0, Max=1, InitialValue="0")  % Actuator to test max command ratio
aBlowerValveTarget = Simulink.Signal(DataType="single", Min=-360, Max=360, Unit="deg", InitialValue="0")  % Blower valve angular position target
aPatientValveTarget = Simulink.Signal(DataType="single", Min=-360, Max=360, Unit="deg", InitialValue="0")  % Patient valve angular position target
rPatientValveCmdApplied = Simulink.Signal(DataType="single", Min=0, Max=100, Unit="%", InitialValue="0")  % Patient valve opening command applied
nBlowerCtrlCmd = Simulink.Signal(DataType="single", Min=0, Max=100000, Unit="rpm", InitialValue="0")  % Blower motor speed target from pressure control
BTestModeActive = Simulink.Signal(DataType="boolean", InitialValue="0")  % Actuator test mode active flag
NActuatorTested = Simulink.Signal(DataType="Enum: eActuators")  % Actuator currently tested by the actuator test
VTBlowerMotorAnalog = Simulink.Signal(DataType="single", Min=0, Max=5000, Unit="mV", InitialValue="0")  % Blower motor temperature sensor analogic value
NDebugLog5MuxEndValue = Simulink.Parameter(3, DataType="uint8", Min=1, Max=255)  % DebugLog5 frame multiplexer end value
NDebugLog6MuxEndValue = Simulink.Parameter(3, DataType="uint8", Min=1, Max=255)  % DebugLog6 frame multiplexer end value
TBlowerMotorMeasured = Simulink.Signal(DataType="single", Min=-50, Max=300, Unit="°C", InitialValue="0")  % Blower motor temperature measured
BKeyboardRow1In = Simulink.Signal(DataType="boolean", InitialValue="0")  % Keyboard matrix row 1 input
BKeyboardRow2In = Simulink.Signal(DataType="boolean", InitialValue="0")  % Keyboard matrix row 2 input
BKeyboardRow3In = Simulink.Signal(DataType="boolean", InitialValue="0")  % Keyboard matrix row 3 input
BKeyboardCol1Out = Simulink.Signal(DataType="boolean", InitialValue="0")  % Keyboard matrix column 1 output
BKeyboardCol2Out = Simulink.Signal(DataType="boolean", InitialValue="0")  % Keyboard matrix column 2 output
BKeyboardCol3Out = Simulink.Signal(DataType="boolean", InitialValue="0")  % Keyboard matrix column 3 output
BpPeakPlusBtnIn = Simulink.Signal(DataType="boolean", InitialValue="0")  % PPeak increase button input current state (1 pressed, 0 released)
BpPeakMinusBtnIn = Simulink.Signal(DataType="boolean", InitialValue="0")  % PPeak decrease  button input current state (1 pressed, 0 released)
BpPlateaukPlusBtnIn = Simulink.Signal(DataType="boolean", InitialValue="0")  % PPlateau increase button input current state (1 pressed, 0 released)
BpPlateauMinusBtnIn = Simulink.Signal(DataType="boolean", InitialValue="0")  % PPlateau decrease button input current state (1 pressed, 0 released)
BpPeepMinusBtnIn = Simulink.Signal(DataType="boolean", InitialValue="0")  % PEEP decrease button input current state (1 pressed, 0 released)
BpPeepPlusBtnIn = Simulink.Signal(DataType="boolean", InitialValue="0")  % PEEP increase button input current state (1 pressed, 0 released)
BNCycleMinuteMinusBtnIn = Simulink.Signal(DataType="boolean", InitialValue="0")  % Breathing cycles per minute decrease button input current state (1 pressed, 0 released)
BNCycleMinutePlusBtnIn = Simulink.Signal(DataType="boolean", InitialValue="0")  % Breathing cycles per minute increase button input current state (1 pressed, 0 released)
BNCycleMinuteMinusBtnPressed = Simulink.Signal(DataType="boolean", InitialValue="0")  % Breathing cycles per minute decrease button pressed state (1 pressed, 0 released)
BpPlateaukPlusBtnPressed = Simulink.Signal(DataType="boolean", InitialValue="0")  % PPlateau increase button pressed state (1 pressed, 0 released)
BpPlateauMinusBtnPressed = Simulink.Signal(DataType="boolean", InitialValue="0")  % PPlateau decrease button pressed state (1 pressed, 0 released)
BpPeakMinusBtnPressed = Simulink.Signal(DataType="boolean", InitialValue="0")  % PPeak decrease  button pressed state (1 pressed, 0 released)
BpPeakPlusBtnPressed = Simulink.Signal(DataType="boolean", InitialValue="0")  % PPeak increase button pressed state (1 pressed, 0 released)
BpPeepMinusBtnPressed = Simulink.Signal(DataType="boolean", InitialValue="0")  % PEEP decrease button pressed state (1 pressed, 0 released)
BpPeepPlusBtnPressed = Simulink.Signal(DataType="boolean", InitialValue="0")  % PEEP increase button pressed state (1 pressed, 0 released)
BNCycleMinutePlusBtnPressed = Simulink.Signal(DataType="boolean", InitialValue="0")  % Breathing cycles per minute increase button pressed state (1 pressed, 0 released)
BpBlowerValveOutletInError = Simulink.Signal(DataType="boolean", InitialValue="0")  % Blower valve outlet pressure measurement in error flag
pBlowerValveOutletLearnedOffset = Simulink.Signal(DataType="single", Min=0, Max=1500, Unit="mmH2O", InitialValue="0")  % pBlowerValveOutlet measure corrected by the offset
pBlowerValveOutletMaxPeakTarget = Simulink.Signal(DataType="single", Min=-1500, Max=1500, Unit="mmH20", InitialValue="0")  % Blower valve outlet air pressure sensor value offset learned
NpStatQInhalationRaw = Simulink.Signal(DataType="single", Min=0, Max=1, InitialValue="0")  % Inhalation air flow static pressure sensor raw value as a ratio of 0V and full scale voltage range
NpDiffQInhalationRaw = Simulink.Signal(DataType="single", Min=0, Max=1, InitialValue="0")  % Inhalation air flow differential pressure sensor raw value as a ratio of 0V and full scale voltage range
NpStatQExhalationRaw = Simulink.Signal(DataType="single", Min=0, Max=1, InitialValue="0")  % Exhalation air flow static pressure sensor raw value as a ratio of 0V and full scale voltage range
NpDiffQExhalationRaw = Simulink.Signal(DataType="single", Min=0, Max=1, InitialValue="0")  % Exhalation air flow differential pressure sensor raw value as a ratio of 0V and full scale voltage range
QAirInhalation = Simulink.Signal(DataType="single", Min=0, Max=500, Unit="l/min", InitialValue="0")  % Inhalation air flow measured
BQAirInhalationInError = Simulink.Signal(DataType="boolean", InitialValue="0")  % Inhalation air flow measurement in error flag
QAirExhalation = Simulink.Signal(DataType="single", Min=0, Max=500, Unit="l/min", InitialValue="0")  % Exhalation air flow measured
BQAirExhalationInError = Simulink.Signal(DataType="boolean", InitialValue="0")  % Exhalation air flow measurement in error flag
pStatQAirInhalation = Simulink.Signal(DataType="single", Min=0, Max=1500, Unit="mbar", InitialValue="0")  % Static pressure value of Inhalation volumique air flow measurement
pDiffQAirInhalation = Simulink.Signal(DataType="single", Min=-1500, Max=1500, Unit="mbar", InitialValue="0")  % Differential pressure value of Inhalation volumique air flow measurement
BpStatQAirInhalationInError = Simulink.Signal(DataType="boolean", InitialValue="0")  % Inhalation volumique air flow static pressure sensor in error flag
BpDiffQAirInhalationInError = Simulink.Signal(DataType="boolean", InitialValue="0")  % Inhalation volumique air flow differential pressure sensor in error flag
pStatQAirInhalationRaw = Simulink.Signal(DataType="single", Min=0, Max=1500, Unit="mbar", InitialValue="0")  % Unfiltered static pressure value of Inhalation volumique air flow measurement
VpStatQAirInhalation = Simulink.Signal(DataType="single", Min=0, Max=3300, Unit="mV", InitialValue="0")  % Inhalation flow static pressure sensor analogic value
pDiffQAirInhalationRaw = Simulink.Signal(DataType="single", Min=-1500, Max=1500, Unit="mbar", InitialValue="0")  % Unfiltered differential pressure value of Inhalation volumique air flow measurement
VpDiffQAirInhalation = Simulink.Signal(DataType="single", Min=0, Max=3300, Unit="mV", InitialValue="0")  % Inhalation flow differential pressure sensor analogic value
pDiffQAirInhalationOffsetLearned = Simulink.Signal(DataType="single", Min=-1500, Max=1500, Unit="mbar", InitialValue="0")  % Inhalation flow differential pressure sensor offset learned
pStatQAirExhalation = Simulink.Signal(DataType="single", Min=0, Max=1500, Unit="mbar", InitialValue="0")  % Static pressure value of Exhalation volumique air flow measurement
pDiffQAirExhalation = Simulink.Signal(DataType="single", Min=-1500, Max=1500, Unit="mbar", InitialValue="0")  % Differential pressure value of Exhalation volumique air flow measurement
BpDiffQAirExhalationInError = Simulink.Signal(DataType="boolean", InitialValue="0")  % Exhalation volumique air flow differential pressure sensor in error flag
BpStatQAirExhalationInError = Simulink.Signal(DataType="boolean", InitialValue="0")  % Exhalation volumique air flow static pressure sensor in error flag
pDiffQAirExhalationRaw = Simulink.Signal(DataType="single", Min=-1500, Max=1500, Unit="mbar", InitialValue="0")  % Unfiltered differential pressure value of Exhalation volumique air flow measurement
pStatQAirExhalationRaw = Simulink.Signal(DataType="single", Min=0, Max=1500, Unit="mbar", InitialValue="0")  % Unfiltered static pressure value of Exhalation volumique air flow measurement
VpDiffQAirExhalation = Simulink.Signal(DataType="single", Min=0, Max=3300, Unit="mV", InitialValue="0")  % Exhalation flow differential pressure sensor analogic value
VpStatQAirExhalation = Simulink.Signal(DataType="single", Min=0, Max=3300, Unit="mV", InitialValue="0")  % Exhalation flow static pressure sensor analogic value
pDiffQAirExhalationOffsetLearned = Simulink.Signal(DataType="single", Min=-1500, Max=1500, Unit="mbar", InitialValue="0")  % Exhalation flow differential pressure sensor offset learned

DiffPressureProcessingData_T = Simulink.Bus()  % Differential pressure measurement logging data structure
  pUnfiltered: single, Min=-2000, Max=2000  % Unfiltered pressure measured
  VpMeas: single, Min=0, Max=3300, Unit="mV"  % Pressure sensor analogic value
  pOffsetLearned: single, Min=-2000, Max=2000  % Pressure measurement dynamic offset learned
  BOffsetErr: boolean  % Pressure measurement dynamic offset error flag

BpBlowerValveOutletInitError = Simulink.Signal(DataType="boolean", InitialValue="0")  % Blower valve outlet air pressure automatic offset failed
BpStatQAirExhalationInitError = Simulink.Signal(DataType="boolean", InitialValue="0")  % Exhalation volumique air flow static pressure sensor automatic offset failed
BpStatQAirInhalationInitError = Simulink.Signal(DataType="boolean", InitialValue="0")  % Inhalation volumique air flow differential pressure sensor automatic offset failed
BpDiffQAirExhalationInitError = Simulink.Signal(DataType="boolean", InitialValue="0")  % Exhalation volumique air flow differential pressure sensor automatic offset failed
BpDiffQAirInhalationInitError = Simulink.Signal(DataType="boolean", InitialValue="0")  % Inhalation volumique air flow differential pressure sensor automatic offset failed
pStatQAirExhalationOffsetLearned = Simulink.Signal(DataType="single", Min=-1500, Max=1500, Unit="mbar", InitialValue="0")  % Exhalation flow static pressure sensor offset learned
pStatQAirInhalationOffsetLearned = Simulink.Signal(DataType="single", Min=-1500, Max=1500, Unit="mbar", InitialValue="0")  % Inhalation flow static pressure sensor offset learned
BPressureControlUnstable = Simulink.Signal(DataType="boolean", InitialValue="0")  % Pressure control unstable
BRespiratorCycleRunRequest = Simulink.Signal(DataType="boolean", InitialValue="0")  % Run of respirator cycles requested
BRespiratorCycleStopRequest = Simulink.Signal(DataType="boolean", InitialValue="0")  % Stop of respirator cycles requested
BRespiratorCycleStopped = Simulink.Signal(DataType="boolean", InitialValue="0")  % Stop of respirator cycles
BRespiratorInError = Simulink.Signal(DataType="boolean", InitialValue="0")  % Respirator in error
BServiceBtnPressedLong = Simulink.Signal(DataType="boolean", InitialValue="0")  % Service button long press detected
BStopBtnPressedTwice = Simulink.Signal(DataType="boolean", InitialValue="0")  % Stop button double press detected
BnBlowerDecOnly = Simulink.Signal(DataType="boolean", InitialValue="0")  % Blower in Dec only mode
BnBlowerPositiveIncReq = Simulink.Signal(DataType="boolean")  % Blower speed increment requested
BpBlowerValveOutletPlateauStabilizedLastCycle = Simulink.Signal(DataType="boolean", InitialValue="0")  % Blower valve outlet static pressure stabilized for last cycle
BpBlowerValveOutletPlateauStabilized = Simulink.Signal(DataType="boolean", InitialValue="0")  % Blower valve outlet plateau pressure stabilized
BpBlowerValveOutletTargetUpdated = Simulink.Signal(DataType="boolean", InitialValue="0")  % pBlowerValve target updated
BpBlowerValveOutletWarningEna = Simulink.Signal(DataType="boolean", InitialValue="0")  % Diagnostic/Warning on pBlowerValveOutlet enabled
BpEndErrorConfirmed = Simulink.Signal(DataType="boolean", InitialValue="0")  % Error on End-Expiratory pressure confirmed
BpEndErrorDetected = Simulink.Signal(DataType="boolean", InitialValue="0")  % Error on End-Expiratory pressure detected
BpMinErrorConfirmed = Simulink.Signal(DataType="boolean", InitialValue="0")  % Error on pressure Min level confirmed
BpPlateauErrorConfirmed = Simulink.Signal(DataType="boolean", InitialValue="0")  % Error on plateau pressure confirmed
BpPlateauErrorDetected = Simulink.Signal(DataType="boolean", InitialValue="0")  % Error on plateau pressure detected
BpMinErrorDetected = Simulink.Signal(DataType="boolean", InitialValue="0")  % Error on pressure Min level detected
BpPeakErrorDetected = Simulink.Signal(DataType="boolean", InitialValue="0")  % Error on Peak pressure detected
BrValveBlowerForced = Simulink.Signal(DataType="boolean")  % Blower valve position enforced in OL
BrValvePatientForced = Simulink.Signal(DataType="boolean")  % Patient valve position enforced in OL
NCycle = Simulink.Signal(DataType="single", Min=0, Max=65535)  % Cycle index
NMaxPressureSample = Simulink.Parameter(3, DataType="single", Min=0, Max=30)  % Max amount of pressure sample
NRespiratorCycleStatus = Simulink.Signal(DataType="Enum: eRespiratorStates")  % Current breathing phase
NSupervisorStatus = Simulink.Signal(DataType="Enum: eSupervisorStates")  % Supervisor status of Respirator
NWarningEndPressureStatus = Simulink.Signal(DataType="uint8", Min=0, Max=255)  % Warning status on End-Expiratory pressure
NWarningPlateauPressureStatus = Simulink.Signal(DataType="uint8", Min=0, Max=255)  % Warning status on plateau pressure
NWarningPressureOutOfRangeStatus = Simulink.Signal(DataType="uint8", Min=0, Max=255)  % Warning status detailing "Out Of Range" pressure
NWarningTBlowerMotorStatus = Simulink.Signal(DataType="uint8", Min=0, Max=255)  % Warning status on Blower motor temperature
NWarningVBatteryStatus = Simulink.Signal(DataType="uint8", Min=0, Max=255)  % Warning status on battery voltage
QAirLastCycle = Simulink.Signal(DataType="single", Min=-100, Max=100, Unit="L/min")  % Air flow averaged aspirated during last cycle

eRespiratorStates = enum(DataScope="Exported", HeaderFile="RespiratorStates.h", DefaultValue="NRespiratorStart", StorageType="uint8")  % Respirator control states enumeration
  NRespiratorStart = 1
  NRespiratorInInhalationPhase1 = 2
  NRespiratorInInhalationPhase2 = 3
  NRespiratorInExhalation = 4
  NRespiratorStop = 5

nBlowerInc = Simulink.Signal(DataType="single", Min=-50000, Max=50000, Unit="rpm")  % Blower speed increment
pBlowerValveOutletEndLastCycle = Simulink.Signal(DataType="single", Min=-2000, Max=2000, Unit="mmH2O")  % Blower valve outlet pressure End-Expiratory for last cycle
pBlowerValveOutletEndTargetAppliedLastCycle = Simulink.Signal(DataType="single", Min=-2000, Max=2000, Unit="mmH2O")  % Blower valve outlet pressure End-Expiratory target applied on last cycle
pBlowerValveOutletEndTargetApplied = Simulink.Signal(DataType="single", Min=-2000, Max=2000, Unit="mmH2O")  % Blower valve outlet pressure End-Expiratory target applied
pBlowerValveOutletErrorMaxCurrent = Simulink.Signal(DataType="single", Min=-2000, Max=2000, Unit="mmH2O")  % Blower valve outlet pressure error max on current cycle
pBlowerValveOutletErrorMaxLastCycle = Simulink.Signal(DataType="single", Min=-2000, Max=2000, Unit="mmH2O")  % Blower valve outlet pressure error max on last cycle
pBlowerValveOutletExhalationCurrent = Simulink.Signal(DataType="single", Min=-2000, Max=2000, Unit="mmH2O")  % Blower valve outlet pressure on current exhalation
pBlowerValveOutletLastValuesMax = Simulink.Signal(DataType="single", Min=-2000, Max=2000, Unit="mmH2O")  % Max of last blower valve outlet pressure values
pBlowerValveOutletLastValuesMean = Simulink.Signal(DataType="single", Min=-2000, Max=2000, Unit="mmH2O")  % Average of last blower valve outlet pressure values
pBlowerValveOutletLastValuesMin = Simulink.Signal(DataType="single", Min=-2000, Max=2000, Unit="mmH2O")  % Min of last blower valve outlet pressure values
pBlowerValveOutletPeakCurrent = Simulink.Signal(DataType="single", Min=-2000, Max=2000, Unit="mmH2O")  % Blower valve peak pressure of current cycle
pBlowerValveOutletPeakLastCycle = Simulink.Signal(DataType="single", Min=-2000, Max=2000, Unit="mmH2O")  % Blower valve peak pressure of last cycle
pBlowerValveOutletPlateauCurrent = Simulink.Signal(DataType="single", Min=-2000, Max=2000, Unit="mmH2O")  % Blower valve outlet plateau pressure on current cycle
pBlowerValveOutletPlateauLastCycle = Simulink.Signal(DataType="single", Min=-2000, Max=2000, Unit="mmH2O")  % Blower valve outlet plateau pressure on last cycle
pBlowerValveOutletPlateauTargetAppliedLastCycle = Simulink.Signal(DataType="single", Min=-2000, Max=2000, Unit="mmH2O")  % Blower valve outlet pressure plateau target applied on last cycle
pBlowerValveOutletPlateauTargetApplied = Simulink.Signal(DataType="single", Min=-2000, Max=2000, Unit="mmH2O")  % Blower valve outlet pressure plateau target applied
pBlowerValveOutletStaticErrorLastCycle = Simulink.Signal(DataType="single", Min=-2000, Max=2000, Unit="mmH2O")  % Blower valve outlet pressure error on last cycle
pBlowerValveOutletTarget = Simulink.Signal(DataType="single", Min=-2000, Max=2000, Unit="mmH2O")  % Blower valve outlet pressure target appplied
pBlowerValveOutlet = Simulink.Signal(DataType="single", Min=-2000, Max=2000, Unit="mmH2O")  % Blower valve outlet pressure measured
rBlowerValveDerivative = Simulink.Signal(DataType="single", Min=-100, Max=100, Unit="%")  % Derivative term of blower valve
rBlowerValveIntegral = Simulink.Signal(DataType="single", Min=-100, Max=100, Unit="%")  % Integral term of blower valve
rBlowerValveProp = Simulink.Signal(DataType="single", Min=-100, Max=100, Unit="%")  % Propotionnal term of blower valve
rPatientValveDerivative = Simulink.Signal(DataType="single", Min=-100, Max=100, Unit="%")  % Derivative term of patient valve
rPatientValveIntegral = Simulink.Signal(DataType="single", Min=-100, Max=100, Unit="%")  % Integral term of patient valve
rPatientValveProp = Simulink.Signal(DataType="single", Min=-100, Max=100, Unit="%")  % Propotionnal term of patient valve
rPhase1OnInhalation = Simulink.Signal(DataType="single", Min=0, Max=1)  % Duration ratio : Duration to reach pressure target divided by inhalation duration
tCycleMaxDuration = Simulink.Signal(DataType="single", Min=0, Max=255)  % Max cycle time duration
tCycle = Simulink.Signal(DataType="single", Min=0, Max=255)  % Delay since cycle start
tInhalationMaxDurationLastCycle = Simulink.Signal(DataType="single", Min=0, Max=255)  % Inhalation Max time duration of last cycle
tInhalationMaxDuration = Simulink.Signal(DataType="single", Min=0, Max=255)  % Inhalation Max time duration
tStopInhalationPhase1LastCycle = Simulink.Signal(DataType="single", Min=0, Max=255)  % Duration to reach pressure target (pPlateau) during previous cycle
tStopInhalationPhase1 = Simulink.Signal(DataType="single", Min=0, Max=255)  % Duration to reach pressure target (pPlateau)
vAirExhalationCurrent = Simulink.Signal(DataType="single", Min=-0.5, Max=3, Unit="L")  % Air Volume inspirated during current exhalation
vAirExhalationLastCycle = Simulink.Signal(DataType="single", Min=-0.5, Max=3, Unit="L")  % Air Volume Expirated during last cycle
vAirInhalationCurrent = Simulink.Signal(DataType="single", Min=-0.5, Max=3, Unit="L")  % Air Volume inspirated during current inhalation
vAirInhalationLastCycle = Simulink.Signal(DataType="single", Min=-0.5, Max=3, Unit="L")  % Air Volume Inspirated during last cycle
vAirLastCycle = Simulink.Signal(DataType="single", Min=-0.5, Max=3, Unit="L")  % Air Volume aspirated during last cycle

CAN_MESSAGE_BUS = Simulink.Bus()
  Extended: uint8
  Length: uint8
  Remote: uint8
  Error: uint8
  ID: uint32
  Timestamp: double
  Data: uint8[8]

eSupervisorStates = enum(DefaultValue="NRespiratorInit")  % Respirator supervisor states enumeration
  NRespiratorInit = 1
  NRespiratorWait = 2
  NRespiratorTest = 3
  NRespiratorCycle = 4

NDebugLog10MuxEndValue = Simulink.Parameter(1, DataType="uint8")  % DebugLog10 frame multiplexer end value
InputDummiesSum = Simulink.Signal(DataType="boolean", InitialValue="0")  % OR of all inputs dummies

ePinout = enum(DataScope="Exported", HeaderFile="NucleoPinout.h", DefaultValue="A0")  % Nucleo F411RE pinout enumeration
  A0 = 16
  A1 = 17
  A2 = 18
  A3 = 19
  A4 = 20
  A5 = 21
  D0 = 0  % (Not available)
  D1 = 1  % (Not available)
  D2 = 2
  D3 = 3
  D4 = 4
  D5 = 5
  D6 = 6
  D7 = 7
  D8 = 8
  D9 = 9
  D10 = 10
  D11 = 11
  D12 = 12
  D13 = 13  % LED
  D14 = 14
  D15 = 15
  PA_0 = 16  % A0
  PA_1 = 17  % A1
  PA_2 = 1  % D1 (Not available)
  PA_3 = 0  % D0 (Not available)
  PA_4 = 18  % A2
  PA_5 = 13  % D13 (LED)
  PA_6 = 12  % D12
  PA_7 = 11  % D11
  PA_8 = 7  % D7
  PA_9 = 8  % D8
  PA_10 = 2  % D2
  PA_11 = 22
  PA_12 = 23
  PA_13 = 24
  PA_14 = 25
  PA_15 = 26
  PB_0 = 19  % A3
  PB_1 = 27
  PB_2 = 28
  PB_3 = 3  % D3
  PB_4 = 5  % D5
  PB_5 = 4  % D4
  PB_6 = 10  % D10
  PB_7 = 29
  PB_8 = 15  % D15
  PB_9 = 14  % D14
  PB_10 = 6  % D6
  PB_11 = 2147483647  % Do not exist
  PB_12 = 30
  PB_13 = 31
  PB_14 = 32
  PB_15 = 33
  PC_0 = 21  % A5
  PC_1 = 20  % A4
  PC_2 = 34
  PC_3 = 35
  PC_4 = 36
  PC_5 = 37
  PC_6 = 38
  PC_7 = 9  % D9
  PC_8 = 39
  PC_9 = 40
  PC_10 = 41
  PC_11 = 42
  PC_12 = 43
  PC_13 = 44  % User button
  PC_14 = 45
  PC_15 = 46
  PD_2 = 47
  PH_0 = 48
  PH_1 = 49
  NC = 2147483647  % Not connected

MdlTS = 0.01
NLCDDisplayColumns = Simulink.Parameter(20, DataType="uint8")  % LCD display columns number
NLCDDisplayLines = Simulink.Parameter(4, DataType="uint8")  % LCD display lines number
tDisplayUpdatePeriode = 0.2
tControlPeriod = 0.01
nBlowerTargetMax = Simulink.Parameter(55000, StorageClass="ExportedGlobal", DataType="single", Min=0, Max=100000, Unit="rpm")  % Blower speed target max (@100% PWM)
nBlowerTargetMin = Simulink.Parameter(0, StorageClass="ExportedGlobal", DataType="single", Min=0, Max=100000, Unit="rpm")  % Blower speed target min (@0% PWM)
NCyclePerMinDefault = Simulink.Parameter(15, StorageClass="ExportedGlobal", DataType="single", Min=0, Max=100, Unit="cycle/min")  % Default and initial value of number of respiration cycles per minute
nBlowerCmdTestInactive = Simulink.Parameter(0, StorageClass="ExportedGlobal", DataType="single", Min=0, Max=100000, Unit="rpm")  % Blower speed target for inactive test mode (while test mode is active but actuator to test is not the blower motor)
rValveCmdTestInactive = Simulink.Parameter(0, StorageClass="ExportedGlobal", DataType="single", Min=0, Max=100, Unit="%")  % Valve opening target for inactive test mode (while test mode is active but actuator to test is not the valve)
tValveRampTestActive = Simulink.Parameter(2, StorageClass="ExportedGlobal", DataType="single", Min=0, Max=10, Unit="sec")  % Valve opening closing percentage ramp time for active test mode
VAnalogInputSpan = Simulink.Parameter(3300, DataType="single", Min=0, Max=5000, Unit="mV")  % Analogic input electrical span width
nBlowerCmdTestActive = Simulink.Parameter(25000, StorageClass="ExportedGlobal", DataType="single", Min=0, Max=100000, Unit="rpm")  % Blower speed target for active test mode
pBlowerValveOutletScaledMin = Simulink.Parameter(0, StorageClass="ExportedGlobal", DataType="single", Min=0, Max=1500, Unit="mmH20")  % Air pressure sensor physical value range min
VpBlowerValveOutletAnalogMax = Simulink.Parameter(3085, StorageClass="ExportedGlobal", DataType="single", Min=0, Max=5000, Unit="mV")  % Air pressure sensor analogic value max
pBlowerValveOutletScaledMax = Simulink.Parameter(800, StorageClass="ExportedGlobal", DataType="single", Min=0, Max=1500, Unit="mmH20")  % Air pressure sensor physical value range max
VpBlowerValveOutletAnalogMin = Simulink.Parameter(180, StorageClass="ExportedGlobal", DataType="single", Min=0, Max=5000, Unit="mV")  % Air pressure sensor analogic value min
pBlowerValveOutletMaxPeakTargetDefault = Simulink.Parameter(250, StorageClass="ExportedGlobal", DataType="single", Min=0, Max=1500, Unit="mmH20")  % Default and initial value of inhalation peak air pressure target
rInhalationPerCycleDefault = Simulink.Parameter(0.333333, StorageClass="ExportedGlobal", DataType="single", Min=0, Max=1)  % Default and initial value of inhalation exhalation time ratio in a respiration cycle
pBlowerValveOutletMeasureOffset = Simulink.Parameter(0, StorageClass="ExportedGlobal", DataType="single", Min=-100, Max=100, Unit="mmH2O")  % pBlowerValveOutlet sensor offset
tSystemBtnDebounce = Simulink.Parameter(0.05, StorageClass="ExportedGlobal", DataType="double", Min=0, Max=10, Unit="sec")  % System button (with hardware debounce) debounce timeout
rVBatteryMeasuredFilter = Simulink.Parameter(0.8, StorageClass="ExportedGlobal", DataType="single", Min=0, Max=1)  % Battery voltage measurement low pass filter gain
VVBatteryAnalogMin = Simulink.Parameter(0, StorageClass="ExportedGlobal", DataType="single", Min=0, Max=5000, Unit="mV")  % Battery voltage sensor analogic value min
VVBatteryAnalogMax = Simulink.Parameter(3000, StorageClass="ExportedGlobal", DataType="single", Min=0, Max=5000, Unit="mV")  % Battery voltage sensor analogic value max
VBatteryMeasuredScaleMax = Simulink.Parameter(27.6, StorageClass="ExportedGlobal", DataType="single", Min=0, Max=50, Unit="V")  % Battery voltage sensor physical value range max
VBatteryMeasuredScaleMin = Simulink.Parameter(0, StorageClass="ExportedGlobal", DataType="single", Min=0, Max=50, Unit="V")  % Battery voltage sensor physical value range min
rTBlowerMotorMeasuredFilter = Simulink.Parameter(0.8, StorageClass="ExportedGlobal", DataType="single", Min=0, Max=1)  % Blower motor temperature measurement low pass filter gain
rBlowerPwmMinSat = Simulink.Parameter(20, StorageClass="ExportedGlobal", DataType="single", Min=0, Max=100, Unit="%")  % Blower PWM output min (if bellow 0% is applied)
ReleaseVersionMajor = Simulink.Parameter(1, DataType="uint8", Min=0, Max=255)  % Respirator software version major indice
ReleaseVersionMinor = Simulink.Parameter(0, DataType="uint8", Min=0, Max=255)  % Respirator software version minor indice
ReleaseVersionRevision = Simulink.Parameter(0, DataType="uint8", Min=0, Max=255)  % Respirator software version revision indice
tKeyboardBtnDebounce = Simulink.Parameter(0.1, StorageClass="ExportedGlobal", DataType="double", Max=10, Unit="sec")  % Keyboard button (without hardware debounce) debounce timeout
pBlowerValveOutletStaticTgtDefault = Simulink.Parameter(200, StorageClass="ExportedGlobal", DataType="single", Min=0, Max=1500, Unit="mmH20")  % Default and initial value of inhalation plateau air pressure target
pBlowerValveOutletStaticTgtIncrement = Simulink.Parameter(10, StorageClass="ExportedGlobal", DataType="single", Min=0, Max=1500, Unit="mmH2O")  % Inhalation plateau air pressure target increment
pBlowerValveOutletStaticTgtDecrement = Simulink.Parameter(10, StorageClass="ExportedGlobal", DataType="single", Min=0, Max=1500, Unit="mmH2O")  % Inhalation plateau air pressure target increment
pBlowerValveOutletStaticTgtMin = Simulink.Parameter(100, StorageClass="ExportedGlobal", DataType="single", Min=0, Max=1500, Unit="mmH2O")  % Inhalation plateau air pressure target increment
pBlowerValveOutletStaticTgtMax = Simulink.Parameter(400, StorageClass="ExportedGlobal", DataType="single", Min=0, Max=1500, Unit="mmH2O")  % Inhalation plateau air pressure target increment
pPatientValveInletTgtDefault = Simulink.Parameter(100, StorageClass="ExportedGlobal", DataType="single", Min=0, Max=1500, Unit="mmH20")  % Default and initial value of exhalation end air pressure target
pPatientValveInletTgtIncrement = Simulink.Parameter(10, StorageClass="ExportedGlobal", DataType="single", Min=0, Max=1500, Unit="mmH2O")  % Inhalation plateau air pressure target increment
pPatientValveInletTgtDecrement = Simulink.Parameter(10, StorageClass="ExportedGlobal", DataType="single", Min=0, Max=1500, Unit="mmH2O")  % Inhalation plateau air pressure target increment
pPatientValveInletTgtMin = Simulink.Parameter(50, StorageClass="ExportedGlobal", DataType="single", Min=0, Max=1500, Unit="mmH2O")  % Inhalation plateau air pressure target increment
pPatientValveInletTgtMax = Simulink.Parameter(300, StorageClass="ExportedGlobal", DataType="single", Min=0, Max=1500, Unit="mmH2O")  % Inhalation plateau air pressure target increment
NCyclePerMinIncrement = Simulink.Parameter(1, StorageClass="ExportedGlobal", DataType="single", Min=0, Max=1500, Unit="mmH2O")  % Inhalation plateau air pressure target increment
NCyclePerMinDecrement = Simulink.Parameter(1, StorageClass="ExportedGlobal", DataType="single", Min=0, Max=1500, Unit="mmH2O")  % Inhalation plateau air pressure target increment
NCyclePerMinMin = Simulink.Parameter(5, StorageClass="ExportedGlobal", DataType="single", Min=0, Max=1500, Unit="mmH2O")  % Inhalation plateau air pressure target increment
NCyclePerMinMax = Simulink.Parameter(35, StorageClass="ExportedGlobal", DataType="single", Min=0, Max=1500, Unit="mmH2O")  % Inhalation plateau air pressure target increment
fpBlowerValveOutletFilter = Simulink.Parameter(30, StorageClass="ExportedGlobal", DataType="single", Min=0, Max=100, Unit="Hz")  % Blower valve outlet pressure measurement 1st order low pass filter cut off frequency
pBlowerValveOutletOffsetMin = Simulink.Parameter(-50, StorageClass="ExportedGlobal", DataType="single", Min=-200, Max=0, Unit="mmH2O")  % Blower valve outlet pressure measurement auto offset min value
pBlowerValveOutletOffsetMax = Simulink.Parameter(50, StorageClass="ExportedGlobal", DataType="single", Min=0, Max=200, Unit="mmH2O")  % Blower valve outlet pressure measurement auto offset max value
pBlowerValveOutletOffsetRateMax = Simulink.Parameter(100, StorageClass="ExportedGlobal", DataType="single", Min=0, Max=400, Unit="mmH2O")  % Blower valve outlet pressure measurement auto offset rate max
VpBlowerValveOutletAnalogDiagMin = Simulink.Parameter(100, StorageClass="ExportedGlobal", DataType="single", Min=0, Max=5000, Unit="mV")  % Blower valve outlet pressure sensor diagnostic anologic value min
VpBlowerValveOutletAnalogDiagMax = Simulink.Parameter(3200, StorageClass="ExportedGlobal", DataType="single", Min=0, Max=5000, Unit="mV")  % Blower valve outlet pressure sensor diagnostic anologic value max
QInhalationReference = Simulink.Parameter(100, StorageClass="ExportedGlobal", DataType="single", Min=0, Max=1000, Unit="l/min")  % Inhalation flow measurement reference flow
pStaticQInhalationReference = Simulink.Parameter(1013, StorageClass="ExportedGlobal", DataType="single", Min=0, Max=1500, Unit="mbar")  % Inhalation flow measurement reference static pressure
pDifferentialQInhalationReference = Simulink.Parameter(3.723, StorageClass="ExportedGlobal", DataType="single", Min=-50, Max=50, Unit="mbar")  % Inhalation flow measurement reference differential pressure
kAlphaQInhalation = Simulink.Parameter(1.75, StorageClass="ExportedGlobal", DataType="single", Min=0, Max=10)  % Inhalation flow measurement alpha coeficient
kBetaQInhalation = Simulink.Parameter(0.5, StorageClass="ExportedGlobal", DataType="single", Min=0, Max=10)  % Inhalation flow measurement beta coeficient
kBetaQExhalation = Simulink.Parameter(0.5, StorageClass="ExportedGlobal", DataType="single", Min=0, Max=10)  % Exhalation flow measurement beta coeficient
kAlphaQExhalation = Simulink.Parameter(1, StorageClass="ExportedGlobal", DataType="single", Min=0, Max=10)  % Exhalation flow measurement alpha coeficient
pDifferentialQExhalationReference = Simulink.Parameter(4.788, StorageClass="ExportedGlobal", DataType="single", Min=-50, Max=50, Unit="mbar")  % Exhalation flow measurement reference differential pressure
pStaticQExhalationReference = Simulink.Parameter(1013, StorageClass="ExportedGlobal", DataType="single", Min=0, Max=1500, Unit="mbar")  % Exhalation flow measurement reference static pressure
QExhalationReference = Simulink.Parameter(100, StorageClass="ExportedGlobal", DataType="single", Min=0, Max=1000, Unit="l/min")  % Exhalation flow measurement reference flow
pDiffQAirInhalationOffset = Simulink.Parameter(0, StorageClass="ExportedGlobal", DataType="single", Min=-20, Max=20, Unit="mbar")  % Inhalation air flow diffential pressure sensor manual offset
pDiffQAirExhalationOffset = Simulink.Parameter(0, StorageClass="ExportedGlobal", DataType="single", Min=-20, Max=20, Unit="mbar")  % Exhalation air flow diffential pressure sensor manual offset
pStatQAirScaledMin = Simulink.Parameter(1013, StorageClass="ExportedGlobal", DataType="single", Min=0, Max=1500, Unit="mbar")  % Air flow static pressure sensor min scaled value
pStatQAirInhalationOffset = Simulink.Parameter(0, StorageClass="ExportedGlobal", DataType="single", Min=-20, Max=20, Unit="mbar")  % Inhalation air flow static pressure sensor manual offset
fpStatQAirInhalation = Simulink.Parameter(50, StorageClass="ExportedGlobal", DataType="single", Min=0, Max=100, Unit="Hz")  % Inhalation air flow static pressure measurement 1st order low pass filter cut off frequency
fpStatQAirExhalation = Simulink.Parameter(50, StorageClass="ExportedGlobal", DataType="single", Min=0, Max=100, Unit="Hz")  % Exhalation air flow static pressure measurement 1st order low pass filter cut off frequency
VpStatQAirAnalogicDiagMin = Simulink.Parameter(100, StorageClass="ExportedGlobal", DataType="single", Min=0, Max=3300, Unit="mV")  % Air flow static pressure sensor diagnostic analogic threshold min
VpStatQAirAnalogicDiagMax = Simulink.Parameter(3200, StorageClass="ExportedGlobal", DataType="single", Min=0, Max=3300, Unit="mV")  % Air flow static pressure sensor diagnostic analogic threshold max
pDiffQAirAutoOffsetMin = Simulink.Parameter(-5, StorageClass="ExportedGlobal", Min=-20, Max=20, Unit="mbar")  % Air flow diffential pressure sensor automatic offset min
pDiffQAirAutoOffsetMax = Simulink.Parameter(5, StorageClass="ExportedGlobal", DataType="single", Min=-20, Max=20, Unit="mbar")  % Air flow diffential pressure sensor automatic offset max
pDiffQAirAutoOffsetRateMax = Simulink.Parameter(10, StorageClass="ExportedGlobal", Min=0, Max=50, Unit="mbar")  % Air flow diffential pressure sensor automatic offset absolute rate max
VpDiffQAirAnalogicDiagMin = Simulink.Parameter(100, StorageClass="ExportedGlobal", DataType="single", Min=0, Max=3300, Unit="mV")  % Air flow differential pressure sensor diagnostic analogic threshold min
VpDiffQAirAnalogicDiagMax = Simulink.Parameter(3200, StorageClass="ExportedGlobal", DataType="single", Min=0, Max=3300, Unit="mV")  % Air flow differential pressure sensor diagnostic analogic threshold max
pStatQAirExhalationOffset = Simulink.Parameter(0, StorageClass="ExportedGlobal", DataType="single", Min=-20, Max=20, Unit="mbar")  % Exhalation air flow static pressure sensor manual offset
pStatQAirAutoOffsetMin = Simulink.Parameter(-50, StorageClass="ExportedGlobal", DataType="single", Min=-500, Max=500, Unit="mbar")  % Air flow static pressure sensor automatic offset min
pStatQAirAutoOffsetMax = Simulink.Parameter(50, StorageClass="ExportedGlobal", DataType="single", Min=-500, Max=500, Unit="mbar")  % Air flow static pressure sensor automatic offset max
pStatQAirAutoOffsetRateMax = Simulink.Parameter(100, StorageClass="ExportedGlobal", DataType="single", Min=0, Max=1000, Unit="mbar")  % Air flow static pressure sensor automatic offset absolute rate max
pStatQAirScaledMax = Simulink.Parameter(1113, StorageClass="ExportedGlobal", DataType="single", Min=0, Max=1500, Unit="mbar")  % Air flow static pressure sensor max scaled value
VpStatQAirAnalogicMin = Simulink.Parameter(132, StorageClass="ExportedGlobal", DataType="single", Min=0, Max=3300, Unit="mV")  % Air flow static pressure sensor analogic value min
VpStatQAirAnalogicMax = Simulink.Parameter(3102, StorageClass="ExportedGlobal", DataType="single", Min=0, Max=3300, Unit="mV")  % Air flow static pressure sensor analogic value max
VpDiffQAirAnalogicMax = Simulink.Parameter(2970, StorageClass="ExportedGlobal", DataType="single", Min=0, Max=3300, Unit="mV")  % Air flow diffential pressure sensor analogic value min
VpDiffQAirAnalogicMin = Simulink.Parameter(330, StorageClass="ExportedGlobal", DataType="single", Min=0, Max=3300, Unit="mV")  % Air flow diffential pressure sensor analogic value min
NBlowerValveDerivativeGain = Simulink.Parameter(0, StorageClass="ExportedGlobal", DataType="single", Min=0, Max=255)  % PID Derivative gain for Blower valve controler
NPatientValveDerivativeGain = Simulink.Parameter(0, StorageClass="ExportedGlobal", DataType="single", Min=0, Max=255)  % PID Derivative gain for Patient valve controler
NPatientValvePropGain = Simulink.Parameter(2.5, StorageClass="ExportedGlobal", DataType="single", Min=0, Max=255)  % PID proportionnal gain for Patient valve controler
nBlowerCmdInit = Simulink.Parameter(20000, StorageClass="ExportedGlobal", DataType="single", Min=0, Max=100000, Unit="rpm")  % Initial blower speed target
nBlowerCmdMax = Simulink.Parameter(55000, StorageClass="ExportedGlobal", DataType="single", Min=0, Max=100000, Unit="rpm")  % Max blower speed
nBlowerCmdMin = Simulink.Parameter(20000, StorageClass="ExportedGlobal", DataType="single", Min=0, Max=100000, Unit="rpm")  % Min blower speed
nBlowerIncLow = Simulink.Parameter(300, StorageClass="ExportedGlobal", DataType="single", Min=0, Max=100000, Unit="rpm")  % Low blower speed increment
pBlowerValveOutletLearnedOffsetMax = Simulink.Parameter(50, StorageClass="ExportedGlobal", DataType="single", Min=-2000, Max=2000, Unit="mmH2O")  % Max value for learned offset of pressure sensor located at the outlet of the blower valve
pBlowerValveOutletLearnedOffsetMin = Simulink.Parameter(-50, StorageClass="ExportedGlobal", DataType="single", Min=-2000, Max=2000, Unit="mmH2O")  % Min value for learned offset of pressure sensor located at the outlet of the blower valve
pBlowerValveOutletOffset = Simulink.Parameter(0, StorageClass="ExportedGlobal", DataType="single", Min=-2000, Max=2000, Unit="mmH2O")  % Inhalation peak air pressure target offset
pDiffMaxThdForPlateauPlausibility = Simulink.Parameter(15, StorageClass="ExportedGlobal", DataType="single", Min=-2000, Max=2000, Unit="mmH2O")  % Max Pressure difference Threshold between Plateau & End of Exhalation pressure used for plausibility check
pDiffThdForBlowerValveControlActivation = Simulink.Parameter(20, StorageClass="ExportedGlobal", DataType="single", Min=-2000, Max=2000, Unit="mmH2O")  % Pressure difference Threshold for Blower valve control activation
pDiffThdForPatientValveControlActivation = Simulink.Parameter(-30, StorageClass="ExportedGlobal", DataType="single", Min=-2000, Max=2000, Unit="mmH2O")  % Pressure difference Threshold for Patient valve control activation
pErrorPlausibilityThd = Simulink.Parameter(500, StorageClass="ExportedGlobal", DataType="single", Min=-2000, Max=2000, Unit="mmH2O")  % Plateau pressure plausibility error threshold
rDecWarning = Simulink.Parameter(50, StorageClass="ExportedGlobal", DataType="single", Min=0, Max=100)  % Warning decrement
rIncpEndError = Simulink.Parameter(34, StorageClass="ExportedGlobal", DataType="single", Min=0, Max=100)  % Increment value for pEndError confirmation
rIncpMinError = Simulink.Parameter(34, StorageClass="ExportedGlobal", DataType="single", Min=0, Max=100)  % Increment value for pMinError confirmation
rIncpPlateauError = Simulink.Parameter(34, StorageClass="ExportedGlobal", DataType="single", Min=0, Max=100)  % Increment value for pPlateauError confirmation
rPIDIntegralMaxTermForBlowerValve = Simulink.Parameter(100, StorageClass="ExportedGlobal", DataType="single", Min=-100, Max=100)  % MAX integral term value of Blower valve controler
rPIDIntegralMaxTermForPatientValve = Simulink.Parameter(100, StorageClass="ExportedGlobal", DataType="single", Min=-100, Max=100)  % MAX integral term value of patient valve controler
rPIDIntegralMinTermForBlowerValve = Simulink.Parameter(-100, StorageClass="ExportedGlobal", DataType="single", Min=-100, Max=100)  % MIN integral term value of Blower valve controler
rPIDIntegralMinTermForPatientValve = Simulink.Parameter(-100, StorageClass="ExportedGlobal", DataType="single", Min=-100, Max=100)  % MIN integral term value of patient valve controler
rPhase1OnInhalationMaxTarget = Simulink.Parameter(0.4, StorageClass="ExportedGlobal", DataType="single", Min=0, Max=1)  % Ratio of pressure transient Max targeted during inhalation
tBatteryErrorConfirmationDelay = Simulink.Parameter(1, StorageClass="ExportedGlobal", DataType="single", Min=0, Max=255, Unit="s")  % Confirmation delay for Error on Battery voltage
tDelayBeforeRespiratorCycleStart = Simulink.Parameter(3, StorageClass="ExportedGlobal", DataType="single", Min=0, Max=255, Unit="s")  % Respirator initialisation time
tDelayForRespiratorStop = Simulink.Parameter(3, StorageClass="ExportedGlobal", DataType="single", Min=0, Max=255, Unit="s")  % Respirator initialisation time offset for blower startup
tDelayMaxForRespiratorInit = Simulink.Parameter(3, StorageClass="ExportedGlobal", DataType="single", Min=0, Max=255, Unit="s")  % Respirator initialisation time
tDelayMaxForTestMode = Simulink.Parameter(5, StorageClass="ExportedGlobal", DataType="single", Min=0, Max=255, Unit="s")  % Maximum duration of test mode
tMaxDebounceForCycleStop = Simulink.Parameter(2, StorageClass="ExportedGlobal", DataType="single", Min=0, Max=255, Unit="s")  % Minimum duration of service bouton pressing for Test mode activation
tMinDebounceForTestStart = Simulink.Parameter(2, StorageClass="ExportedGlobal", DataType="single", Min=0, Max=255, Unit="s")  % Minimum duration of service bouton pressing for Test mode activation
tStopInhalationPhase1Min = Simulink.Parameter(0.175, StorageClass="ExportedGlobal", DataType="single", Min=0, Max=255, Unit="s")  % Minimum duration of pressure transient target
tTBlowerMotorErrorConfirmationDelay = Simulink.Parameter(1, StorageClass="ExportedGlobal", DataType="single", Min=0, Max=255, Unit="s")  % Confirmation delay for Error on Blower motor temperature
NActuatorActive = Simulink.Parameter(Simulink.data.Expression(ExpressionString="eActuators.None"), StorageClass="ExportedGlobal", DataType="Enum: eActuators")  % Actuator test mode state calibration
rActuatorCmdMaxRatio = Simulink.Parameter(0, StorageClass="ExportedGlobal", DataType="single", Min=0, Max=1)  % Actuator test mode max command ratio
NDebugLog9MuxEndValue = Simulink.Parameter(3, DataType="uint8", Min=1, Max=255)  % DebugLog9 frame multiplexer end value
pDiffQAirScaledMax = Simulink.Parameter(5, StorageClass="ExportedGlobal", DataType="single", Min=-100, Max=100, Unit="mbar")  % Air flow diffential pressure sensor max scaled value
pDiffQAirScaledMin = Simulink.Parameter(-5, StorageClass="ExportedGlobal", DataType="single", Min=-100, Max=100, Unit="mbar")  % Air flow diffential pressure sensor min scaled value
QAirDeadZoneThd = Simulink.Parameter(6, StorageClass="ExportedGlobal", DataType="single", Min=0, Max=1000, Unit="l/min")  % Dead zone threshold for Vt computation
nBlowerIncHigh = Simulink.Parameter(1500, StorageClass="ExportedGlobal", DataType="single", Min=0, Max=100000, Unit="rpm")  % High blower speed increment
nBlowerIncMedium = Simulink.Parameter(750, StorageClass="ExportedGlobal", DataType="single", Min=0, Max=100000, Unit="rpm")  % Medium blower speed increment
nBlowerDecHigh = Simulink.Parameter(1500, StorageClass="ExportedGlobal", DataType="single", Min=0, Max=100000, Unit="rpm")  % High blower speed decrement
nBlowerDecMedium = Simulink.Parameter(750, StorageClass="ExportedGlobal", DataType="single", Min=0, Max=100000, Unit="rpm")  % Medium blower speed decrement
pErrorThdForHighBlowerDec = Simulink.Parameter(37.5, StorageClass="ExportedGlobal", DataType="single", Min=-2000, Max=2000, Unit="mmH2O")  % Plateau pressure error threshold to request an high decrement of blower speed
pStaticErrorThdForHighBlowerInc = Simulink.Parameter(37.5, StorageClass="ExportedGlobal", DataType="single", Min=-2000, Max=2000, Unit="mmH2O")  % Plateau pressure error threshold to request an high increment of blower speed
tBlowerValveOpen = Simulink.Parameter(0.25, StorageClass="ExportedGlobal", DataType="single", Min=0, Max=255, Unit="s")  % Blower valve opening time
tPatientValveOpen = Simulink.Parameter(0.25, StorageClass="ExportedGlobal", DataType="single", Min=0, Max=255, Unit="s")  % Patient valve opening time
tPhase1Ofs = Simulink.Parameter(0, StorageClass="ExportedGlobal", DataType="single", Min=0, Max=255, Unit="s")  % Offset duration of Phase 1 (dedicated to mapping)
NBlowerValvePropGain = Simulink.Parameter(2.5, StorageClass="ExportedGlobal", DataType="single", Min=0, Max=255)  % PID proportionnal gain for Blower valve controler
NBlowerValveIntegralGain = Simulink.Parameter(37.5, StorageClass="ExportedGlobal", DataType="single", Min=0, Max=255)  % PID integral gain for Blower valve controler
NPatientValveIntegralHighGain = Simulink.Parameter(130, StorageClass="ExportedGlobal", DataType="single", Min=0, Max=255)  % PID integral gain for Patient valve controler
NPatientValveIntegralGain = Simulink.Parameter(37.5, StorageClass="ExportedGlobal", DataType="single", Min=0, Max=255)  % PID integral gain for Patient valve controler
NBlowerSpeedIncCorrectionGain = Simulink.Parameter(1, StorageClass="ExportedGlobal", DataType="single", Min=0, Max=255)  % Correction factor on Blower speed increment
fpDiffQAirExhalation = Simulink.Parameter(10, StorageClass="ExportedGlobal", DataType="single", Min=0, Max=100, Unit="Hz")  % Exhalation air flow differential pressure measurement 1st order low pass filter cut off frequency
fpDiffQAirInhalation = Simulink.Parameter(10, StorageClass="ExportedGlobal", DataType="single", Min=0, Max=100, Unit="Hz")  % Inhalation air flow differential pressure measurement 1st order low pass filter cut off frequency
NBlowerValveIntegralHighGain = Simulink.Parameter(75, StorageClass="ExportedGlobal", DataType="single", Min=0, Max=255)  % PID integral gain for Blower valve controler (Error < 0 = overshoot)